# Grasshopper definition Hex_Planarization LaplacianSmooth AngleSum CoPlanar .gh (Grasshopper 1.0.8)
# plug-ins: Topologizer, Kangaroo2 Components

crv = Curve([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])
disc = Discontinuity(Curve=crv, Level=1)  # -> Points, Parameters
# https://discourse.mcneel.com/t/planarize-cells-coming-from-kangaroo-simulation/109855/4?u=quan_li
explode = Explode(Curve=crv, Recursive=True)  # -> flatten(Segments), Vertices
pt = Point(disc.Points)
pdecon = Deconstruct(Point=disc.Points)  # -> XComponent, YComponent, flatten(ZComponent)
shift = ShiftList(List=pt, Shift=1, Wrap=True)  # -> graft(List)
shift_2 = ShiftList(List=pt, Shift=0, Wrap=True)  # -> graft(List)
avr = Average(Input=pt)
lng = ListLength(List=pt)
dupln = RemoveDuplicateLines(Lines=flatten(explode.Segments), Tolerance=0.01)
smaller = SmallerThan(FirstNumber=pdecon.ZComponent, SecondNumber="0.1")  # -> SmallerThan, OrEqualTo
dup = DuplicateData(Data=avr, Number=lng, Order=True)  # -> graft(Data)
topo = Topologizer(LinesInput=dupln, Tolerance=0.01)  # -> L, P, S, E, N, I, O, G
cull = CullPattern(List=flatten(disc.Points), CullPattern=smaller.SmallerThan)
triangle = MeshTriangle(CornerA=0, CornerB=1, CornerC=2)
item = ListItem(List=topo.P, Index=topo.N, Wrap=True)
merge = Merge(Data1=shift_2, Data2=shift, Data3=dup)
conmesh = ConstructMesh(Vertices=[shift_2, shift, dup], Faces=triangle)
ln = Line(StartPoint=avr, EndPoint=pt)
lng_2 = ListLength(List=topo.N)
pshift = ShiftPaths(Data=conmesh, Offset=-1)
duppt = RemoveDuplicatePts(Points=cull, Tolerance=0.01)
clean = CombineClean(Meshes=pshift)  # -> flatten(Mesh)
equals = Equality(FirstNumber=lng_2, SecondNumber="3")  # -> Equality, Inequality
pshift_2 = ShiftPaths(Data=merge, Offset=-1)
duppt_2 = RemoveDuplicatePts(Points=disc.Points, Tolerance=0.01)
Z = UnitZ(Factor=Slider(0.109, range=0..1))

# ----
# LaplacianSmooth AngleSum CoPlanar Load
laplaciansmooth = CSharpScript(
    Centre=graft(topo.P),
    Neighbours=item,
    Strength=Slider(9.647, range=0..21),
    Reference="C:\Program Files\Rhino 8\Plug-ins\Grasshopper\Components\KangarooSolver.dll")  # -> out, flatten(A); inputs Centre: Point3d, Neighbours: list of Point3d, Strength: Double
# ---------- laplaciansmooth: C# ----------
    List<Point3d> pts = new List<Point3d>();
    pts.Add(Centre);
    pts.AddRange(Neighbours);
    A = new KangarooSolver.Goals.LaplacianSmooth(pts.ToArray(), Strength);
# ---------- end laplaciansmooth ----------
length_line = LengthLine(Line=explode.Segments, Strength=0.1)
anchor = Anchor(Point=duppt_2, Strength=0.1)
anchor_2 = Anchor(Point=duppt, Strength=1000)
coplanar = CoPlanar(Points=disc.Points, Strength=10)
show = Show(G=clean)
anglesum = CSharpScript(P=pshift_2, k=1, Reference="C:\PROGRAM FILES\RHINO 8\PLUG-INS\GRASSHOPPER\COMPONENTS\KangarooSolver.dll")  # -> out, A; inputs P: list of Point3d, k: Double
# ---------- anglesum: C# usings ----------
using System.IO;
using System.Linq;
using System.Data;
using System.Drawing;
using System.Reflection;
using System.Windows.Forms;
using System.Xml;
using System.Xml.Linq;
using System.Runtime.InteropServices;

using Rhino.DocObjects;
using Rhino.Collections;
using GH_IO;
using GH_IO.Serialization;
using KangarooSolver;
using KangarooSolver.Goals;
# ---------- anglesum: C# ----------
    A = new AngleSum(P.ToArray(), Math.PI * 2, k);
# ---------- anglesum: C# additional code ----------
  public class AngleSum : GoalObject
  {
    double targetSum;
    public AngleSum(Point3d[] pts, double targetSum, double strength)
    {
      PPos = pts;
      Move = new Vector3d[pts.Length];
      Weighting = new double[pts.Length];
      for(int i = 0;i < pts.Length;i++) Weighting[i] = strength;
      this.targetSum = targetSum;
    }

    public override void Calculate(List<KangarooSolver.Particle> p)
    {

      //take sets of 3 points
      //find angles
      //get total angle and required change
      //for each angle,
      //get intersection of bisector with line between arm ends
      //move angle pt along vector to this

      var pts = this.GetCurrentPositions(p);
      for(int i = 0;i < pts.Length;i++)Move[i] = Vector3d.Zero;


      double[] angles = new double[pts.Length / 3];
      double angleSum = 0;

      for(int i = 0;i < pts.Length;i += 3)
      {
        Point3d apex = pts[i];
        Point3d endA = pts[i + 1];
        Point3d endB = pts[i + 2];
        double angle = Vector3d.VectorAngle(endA - apex, endB - apex);
        angles[i / 3] = angle;
        angleSum += angle;
      }


      double m = targetSum / angleSum;

      for(int i = 0;i < pts.Length;i += 3)
      {
        Point3d apex = pts[i];
        Point3d endA = pts[i + 1];
        Point3d endB = pts[i + 2];

        Vector3d va = endA - apex;
        Vector3d vb = endB - apex;
        va.Unitize();
        vb.Unitize();
        Line bisector = new Line(apex, va + vb);
        Line ab = new Line(endA, endB);
        double ta,tb;
        Rhino.Geometry.Intersect.Intersection.LineLine(ab, bisector, out ta, out tb, 0, false);
        Vector3d v = apex - bisector.PointAt(tb);

        Move[i] += v * 0.1 * (1.0 - m);
      }



    }

    public override object Output(List < KangarooSolver.Particle > p)
    {
      return null;
    }
  }
# ---------- end anglesum ----------
length_line_2 = LengthLine(Line=ln, Length=0, Strength=0.01)

load = Load(Point=duppt_2, ForceVector=Z, Weighting=1)
cull_2 = CullPattern(List=laplaciansmooth.A, CullPattern=flatten(equals.Equality))
entwine = Entwine(
    Branch00=show,
    Branch01=[anchor_2, length_line, coplanar, cull_2, anchor, load, anglesum.A, length_line_2],
    FlattenInputs=True)
reset = Button()
solver = Solver(GoalObjects=entwine, Reset=reset, Threshold=1e-15, Tolerance=0.01, On=Toggle(False))  # -> I, V, O
bang = ExplodeTree(Data=solver.O)  # -> Branch0, Branch1
mesh = Mesh(bang.Branch0)
lng_3 = ListLength(List=mesh)
medges = MeshEdges(Mesh=mesh)  # -> NakedEdges, InteriorEdges, NonManifoldEdges
unweld = UnweldMesh(Mesh=mesh, Angle=0)
random = Random(Range=Domain(0, 1), Number=lng_3, Seed=2)
crv_2 = Curve(medges.NakedEdges)
gradient = Gradient(
    LowerLimit=0,
    UpperLimit=1,
    Parameter=random,
    stops=[0: RGB(255, 255, 255), 0.547: RGB(255, 192, 128), 1: RGB(216, 191, 216)])
preview = CustomPreview(Geometry=unweld, Material=gradient)
