# Grasshopper definition Growing_line_with_friction Angle Collider.gh (Grasshopper 1.0.7)
# plug-ins: Kangaroo2 Components, Vipers

number_slider = Slider(360, range=0..500)
segments_length = Slider(2, range=0..11)

# ---- group: Starting curves
curve = Curve([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])
curve_2 = Curve([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])

# ----
len = Length(Curve=curve)
multiplication = Multiplication(A=number_slider, B=0.6486)
division = Division(A=len, B=segments_length)
divide = DivideCurve(Curve=curve, Count=division, Kinks=False)  # -> simplify(Points), Tangents, Parameters
plane_surface = PlaneSurface(Plane=PlaneXY(0, 0, 0), XSize=number_slider, YSize=multiplication)

# ---- group: Random movement to avoid stalling of straight lines
vec = Vector(divide.Points)
amp = Amplitude(Vector=vec, Amplitude="0.15")
lng = ListLength(List=amp)
random = Random(Range="0 to 2*Pi", Number=lng, Seed=2)
rotate = Rotate(Geometry=amp, Angle=random, Plane=PlaneXY(0, 0, 0))  # -> simplify(Geometry), Transform

# ----
mesh_surface = MeshSurface(Surface=plane_surface, UCount=5, VCount=5, Overhang=True, Equalize=False)

# ---- group: Starting mesh
mesh = Mesh(mesh_surface)

# ----
move = Move(Geometry=divide.Points, Motion=rotate.Geometry)  # -> Geometry, Transform
pline = PolyLine(Vertices=move.Geometry, Closed=Toggle(True))  # -> flatten(Polyline)
explode = Explode(Curve=pline, Recursive=True)  # -> Segments, Vertices
number_slider_2 = Slider(1.291, range=0.3..16)
shift = ShiftList(List=explode.Segments, Shift=1, Wrap=True)
list = ValueList({"One": 1, "Two": 2, "Three": 2² - 1, "Four": Sqrt(16)}, selected="Three")
multiplication_2 = Multiplication(A=number_slider_2, B=list)
asd = Asd(line=explode.Segments)  # -> line_4, int_3, int_4
cluster = Cluster(pt=move.Geometry)  # -> pt_4, int_2, int_4

show = Show(G=pline)
onmesh = OnMesh(Points=move.Geometry, Mesh=mesh, Strength="2000")
length_line = LengthLine(Line=flatten(explode.Segments), Length=Slider(8, range=0..100), Strength="10")
angle = Angle(LineA=explode.Segments, LineB=shift, RestAngle="0", Strength="1500")
collider = Collider(Objects=cluster.pt_4, Radii=multiplication_2, IgnoreA=cluster.int_2, IgnoreB=cluster.int_4, Strength="1000")
collider_2 = Collider(Objects=asd.line_4, Radii=number_slider_2, IgnoreA=asd.int_3, IgnoreB=asd.int_4, Strength="1000")

entwine = Entwine(
    Branch00=show,
    Branch01=onmesh,
    Branch02=length_line,
    Branch03=angle,
    Branch04=collider,
    Branch05=collider_2,
    FlattenInputs=True)
reset = Button()
on = BooleanToggle(False)
solver = Solver(GoalObjects=entwine, Reset=reset, Threshold=1e-15, Tolerance=0.01, On=on)  # -> I, V, O
bang = ExplodeTree(Data=solver.O)  # -> Branch0, Branch1, Branch2, Branch3, Branch4, Branch5
crv = Curve(bang.Branch0)
cls = Closed(Curve=crv)  # -> Closed, Periodic
explode_2 = Explode(Curve=crv, Recursive=True)  # -> Segments, Vertices
intcrv = Interpolate(Vertices=explode_2.Vertices, Degree=3, Periodic=graft(cls.Closed), KnotStyle=1)  # -> Curve, Length, Domain
randomgeometrycolor = RandomColor(Property=intcrv.Curve, Colour=RGB(255, 255, 0), Seed=0)

# ==== cluster Asd
line = ClusterInput()
line_2 = Line(line)
line_3 = Line(flatten(line_2))
lng = ListLength(List=line_3)
lng_2 = ListLength(List=line_2)  # -> flatten(Length)
series = Series(Start=0, Step=1, Count=lng)
line_4 = ClusterOutput(line_3)
partition = PartitionList(List=series, Size=lng_2)
shift = ShiftList(List=partition, Shift=1, Wrap=True)
int = Integer(flatten(partition))
int_2 = Integer(flatten(shift))
int_3 = ClusterOutput(int)
int_4 = ClusterOutput(int_2)

# ==== cluster Cluster
pt = ClusterInput()
pt_2 = Point(pt)
pt_3 = Point(flatten(pt_2))
pt_4 = ClusterOutput(pt_3)
lng = ListLength(List=pt_2)  # -> flatten(Length)
index = Index(L=pt_3)
partition = PartitionList(List=index, Size=lng)
int = Integer(flatten(partition))
shift = ShiftList(List=partition, Shift=1, Wrap=True)
int_2 = ClusterOutput(int)
int_3 = Integer(flatten(shift))
int_4 = ClusterOutput(int_3)

# ==== cluster Index: Quan Li
L = ClusterInput()
lng = ListLength(List=L)
series = Series(Start=0, Step=1, Count=lng)
S = ClusterOutput(series)
